# Grasshopper definition 10-responsive-hull-search.gh (Grasshopper 1.0.8)
# plug-ins: Hawa

# ---- group: 01 / SHAPE GENES + FIXED VOLUME
hull_color = ColourSwatch(SwatchColor=RGB(174, 202, 207))
bow_fullness = Slider(0.8, range=0.4..1.6)
stern_fullness = Slider(0.8, range=0.4..1.6)
beam_draft = Slider(2, range=1..3)
fixed_length_m = Slider(8, range=6..10)
fixed_volume_m³ = Slider(6, range=4..8)
hull = HawaParametricHull(
    Length=fixed_length_m,
    Volume=fixed_volume_m³,
    BowFullness=bow_fullness,
    SternFullness=stern_fullness,
    BeamDraft=beam_draft,
    DeckCenter=Point(8, 6.1, 5.1))  # -> Hull, Sections, Volume, Dimensions
preview = CustomPreview(Geometry=hull.Hull, Material=hull_color)
panel = Panel(hull.Dimensions)

# ---- group: 02 / FIXED TANK + FLUID
# HAWA / RESPONSIVE HULL SEARCH
# A closed canoe hull in single phase flow. Length = 8 m; mesh volume = 6 m³. No waves, free surface, buoyancy or boat motion.
# 1 Change the three shape sliders.  2 Enable evaluation.  3 Enable Search. Pause and cancel remain available.
# Each candidate starts fresh and completes the same iteration count. Fitness is mean X momentum exchange / (0.5 rho U² V^(2/3)).
# The coarse grid and viscous fluid keep this example small. Refine the grid and check duration before comparing engineering designs.
fixed_tank_meters = Box({Plane=PlaneXY(0, 0, 0), X=Domain(0, 24), Y=Domain(0, 12), Z=Domain(0, 10)})
boundary = HawaBoundaries(X="inlet", X_2="outlet", Y="slip", Y_2="slip", Z="slip", Z_2="slip")
cell_size_m = Slider(0.4, range=0.25..1)
domain = HawaDomain(Box=fixed_tank_meters, CellSize=cell_size_m, LengthUnits="meters")  # -> Domain, Bounds, Grid
geometry = HawaGeometry(Domain=domain.Domain, Obstacles=hull.Hull)  # -> Geometry, SolidCells
flow_speed_m_s = Slider(1, range=0.5..2)
viscosity_m²_s = Slider(0.1, range=0.05..0.2)
physics = HawaPhysics(Speed=flow_speed_m_s, Viscosity=viscosity_m²_s, Density=1000, Collision="regularized", LatticeMach=0.05)
case = HawaCase(Domain=domain.Domain, Geometry=geometry.Geometry, Physics=physics, Boundaries=boundary)

# ----
pause = BooleanToggle(False)
cancel_evaluation = BooleanToggle(False)

# ---- group: 03 / COMPLETE EACH CANDIDATE
backend = ValueList({"auto", "mps", "cuda:0", "cpu"}, selected="auto")
run_search = BooleanToggle(False)
iterations_per_candidate = Slider(200, range=40..2000)
final_averaging_window = Slider(20, range=5..100)
evaluate = HawaEvaluate(
    Case=case,
    Device=backend,
    Iterations=iterations_per_candidate,
    AverageWindow=final_averaging_window,
    ReferenceVolume=fixed_volume_m³,
    Enable=run_search,
    Pause=pause,
    Cancel=cancel_evaluation)  # -> Fitness, Solution, Resistance, Report, Candidate
panel_2 = Panel(evaluate.Report)

# ---- group: 04 / FITNESS + FLOW
upstream_seeds = Point([Point(2, 4, 4), Point(2, 4.5, 4), Point(2, 5, 4), Point(2, 5.5, 4), Point(2, 6, 4), Point(2, 6.5, 4), Point(2, 7, 4), Point(2, 7.5, 4), Point(2, 8, 4)])
slice = HawaSlice(Solution=evaluate.Solution, Axis=2, Index=8, Field="speed", Mean=False)  # -> Mesh, Values, Range, Valid
streamlines = HawaStreamlines(Solution=evaluate.Solution, Seeds=upstream_seeds, Steps=100)
fitness_minimize = Panel(evaluate.Fitness)

# ----
bounds = HawaDomainPreview(Domain=domain.Domain)  # -> Edges, FaceCenters, Labels

# ---- group: 05 / SEARCH THE SHAPE
# RESPONSIVE SEARCH
# The search changes the three sliders only after a completed result.
# Pause controls the search and the active evaluation.
# Run false cancels evaluation. Re-enable to start a new search.
# Best fitness and genes remain available after the candidate budget completes.
candidate_budget = Slider(5, range=2..20)
search = HawaSearch(
    Genes=[bow_fullness, stern_fullness, beam_draft],
    Fitness=evaluate.Fitness,
    Candidate=evaluate.Candidate,
    Run=run_search,
    Pause=pause,
    Budget=candidate_budget,
    Mutation=0.15,
    RestoreBest=False)  # -> BestFitness, BestGenes, History, State
panel_3 = Panel(search.History)
