# Grasshopper definition 14-curved-sphere-pressure.gh (Grasshopper 1.0.8)
# plug-ins: Hawa

# ---- group: 01 / INPUTS
length_units = ValueList({"model", "meters", "millimeters"}, selected="meters")
closed_sphere_edit_mesh = Mesh(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)
# Hawa guide / purpose: HAWA / 14
# Stationary curved sphere
# 
# Run the sphere. Inspect pressure and surface samples; compare grid spacings.
domain_meters = Box({Plane=PlaneXY(0, 0, 0), X=Domain(0, 16), Y=Domain(0, 8), Z=Domain(0, 8)})
colors = HawaColorMap(Palette="blue-green", Minimum=0, Maximum=1.6, Units="m/s")  # -> Map, Colors, Labels
cell_size_model_units = Slider(0.5, range=0.25..1)

# ---- group: 02 / GEOMETRY
# Hawa guide / operation: START / PAUSE / RESET
# Read left to right. Inputs and controls are at the left; results are at the right.
# 
# Save a copy before editing. Wait for preparation. Enable Run only when ready. Solve: Run false pauses; Reset clears state. Evaluate/Search/Record: disabling cancels.
# 
# For recordings, set a new absolute directory before starting.
domain = HawaDomain(Box=domain_meters, CellSize=cell_size_model_units, LengthUnits=length_units)  # -> Domain, Bounds, Grid
geocheck = HawaGeometryCheck(Meshes=closed_sphere_edit_mesh, Spacing=0.5)  # -> ClosedValid, OpenEdges, Report
legend = HawaLegend(Map=colors.Map, Plane=PlaneXY(18, 1, 0), Height=4)  # -> Legend, Labels, Locations
viscosity_m²_s = Slider(0.1, range=0.01..0.5)

# ---- group: 03 / GEOMETRY
physics = HawaPhysics(Speed=1, Viscosity=viscosity_m²_s, Density=1.225, Collision="regularized", LatticeMach=0.05)
boundary = HawaBoundaries(X="inlet", X_2="outlet", Y="periodic", Y_2="periodic", Z="wall", Z_2="slip")
geometry = HawaGeometry(Domain=domain.Domain, Obstacles=closed_sphere_edit_mesh, CurvedWalls=True)  # -> Geometry, SolidCells
# Hawa guide / limits: CHECK THE RESULT
# Experimental stationary curved links. Do not combine with refinement or moving bodies.
# 
# Use the case report and component messages. Compare physical time and fixed colour ranges.
# 
# Examples and MCP instructions: README.md and ../../docs/agents/rhino-mcp.md
bounds = HawaDomainPreview(Domain=domain.Domain)  # -> Edges, FaceCenters, Labels

# ---- group: 04 / BUILD CASE
backend = ValueList({"auto", "mps", "cuda:0", "cpu"}, selected="auto")
case = HawaCase(Domain=domain.Domain, Geometry=geometry.Geometry, Physics=physics, Boundaries=boundary)
grid = HawaGridPreview(Geometry=geometry.Geometry)  # -> Voxels, Volume
target_iterations = Slider(300, range=25..2000)
run_pause = BooleanToggle(False)
reset = BooleanToggle(False)

# ---- group: 05 / RUN / CONTROL
solve = HawaSolve(Case=case, Device=backend, TargetSteps=target_iterations, Run=run_pause, Reset=reset)  # -> Solution, State, Steps, Monitor
box = Box({Plane=PlaneXY(0, 0, 0), X=Domain(1, 2), Y=Domain(1, 7), Z=Domain(1, 6)})

# ---- group: 06 / CAPTURE / PLAYBACK
panel = Panel(solve.Monitor)
frame = HawaFieldSnapshot(Solution=solve.Solution, Mean=False)  # -> Frame, Time
colors_2 = HawaColorMap(Palette="spectrum", Minimum=0, Maximum=4, Units="Cp")  # -> Map, Colors, Labels
seeds = HawaSeedPoints(Box=box, XCount=2, YCount=8, ZCount=8)
rec = Rectangle({Plane=PlaneXY(0, 0, 2), Size=Domain2(u=0..18, v=0..8)})

# ---- group: 07 / RESULTS / CONTROLS
surface = HawaSurfaceField(Frame=frame.Frame, Surface=closed_sphere_edit_mesh, Field="cp", Offset=0.6, Colors=colors_2.Map)  # -> ColoredSurface, Valid, Values
plane = HawaPlaneField(Frame=frame.Frame, Rectangle=rec, Resolution=30, Field="speed", Colors=colors.Map, ContourLevels=[0.4, 0.8, 1.2])  # -> Mesh, Contours, Values
flow = HawaFlowDisplay(Frame=frame.Frame, Seeds=seeds, Colors=colors.Map, Field="speed", Steps=150, Radius=0.03, Backward=False)  # -> Lines, Tubes
iso = HawaIsosurface(Frame=frame.Frame, Field="speed", Level=0.5, Stride=2)
